# Grasshopper definition robot_control.gh (Grasshopper 1.0.7)
# plug-ins: VirtualRobot.Grasshopper, Hops

# ---- group: Calibration Parameters
save = Button()
filename = Text("Targets\targets_test.json")

# ---- group: Robot Definition
pt = Point(<point referenced from the Rhino model>)
yz = YZPlane(Origin=pt)
rotate = Rotate(Geometry=yz, Angle=degrees("90"), Plane=yz)  # -> Geometry, Transform
brep = Brep(<brep referenced from the Rhino model>)
end_effector = DefineEndEffector(Geometry=brep, TCPFrame=rotate.Geometry, MountingFrame=PlaneXY(0, 0, 0))
kuka_kr_210 = PredefinedKUKAKR210Robot(RobRootFrame=PlaneXY(0, 0, 0), EndEffectorOptional=end_effector, variant="R2700")

# ---- group: Calibration Parameters
distance_domain = Panel("500 to 1000")
angle_domain_deg = Panel("0 to 45")
target_surface = Curve(<curve referenced from the Rhino model>)
num_batches = Number("2")
range = Range(Domain=distance_domain, Steps=expr("x-1", num_batches))
num_shots = Number("3")
range_2 = Range(Domain=angle_domain_deg, Steps=expr("x-1", num_shots))
target = Rectangle(target_surface)
distances = Number(range)
angles = Number(range_2)

# ----
target_loc = Point(<point referenced from the Rhino model>)
pos_loc = Point(<point referenced from the Rhino model>)
rootdir = GhPythonScript()  # -> rootdir
# ---------- rootdir: Python ----------
rootdir = ghdoc.Path.rsplit("\\", 1)[0] + "\\"
# ---------- end rootdir ----------
ln = Line(StartPoint=pos_loc, EndPoint=target_loc)
concat = Concatenate(FragmentA=rootdir, FragmentB="Models\")
target_2 = Rectangle(target)
pdecon = Deconstruct(Point=pos_loc)  # -> XComponent, YComponent, ZComponent
pdecon_2 = Deconstruct(Point=target_loc)  # -> XComponent, YComponent, ZComponent
number_slider = Slider(1000, range=0..2000)
explode = Explode(Curve=target_2, Recursive=True)  # -> Segments, Vertices
hops = Hops(
    Pos_x=pdecon.XComponent,
    Pos_y=pdecon.YComponent,
    Pos_z=pdecon.ZComponent,
    Target_x=pdecon_2.XComponent,
    Target_y=pdecon_2.YComponent,
    Target_z=pdecon_2.ZComponent,
    FilePath=concat,
    CacheResultsInMemory=True,
    CacheSolveResults=True,
    RemoteDefinitionLocation="http://127.0.0.1:5000/Calibration",
    RemoteSolveVersion=(0, 1, 0),
    ShowInput_Enabled=False,
    ShowInput_Path=False,
    SynchronousSolve=True)
item = ListItem(List=explode.Segments, Index=0, Wrap=True)  # -> Item, Item1, Item2
end = EndPoints(Curve=item.Item1)  # -> Start, End
vec2pt = Vector2Pt(PointA=end.End, PointB=end.Start, Unitize=False)  # -> Vector, Length
panel = Panel(hops)
Z = UnitZ(Factor=number_slider)
amp = Amplitude(Vector=vec2pt.Vector, Amplitude=number_slider)
move = Move(Geometry=item.Item2, Motion=amp)  # -> Geometry, Transform
midpt = CurveMiddle(Curve=move.Geometry)
scale = Scale(Geometry=move.Geometry, Center=midpt, Factor=0.5)  # -> Geometry, Transform
num_batches_2 = Number(expr("x-1", num_batches))
target_3 = Rectangle(target)
divide = DivideCurve(Curve=scale.Geometry, Count=num_batches_2, Kinks=False)  # -> Points, Tangents, Parameters
boundary = BoundarySurfaces(Edges=target_3)
srf_cp = SurfaceClosestPoint(Point=divide.Points, Surface=boundary)  # -> Point, UVPoint, Distance
distances_2 = Number(distances)
evalsrf = EvaluateSurface(Surface=boundary, Point=srf_cp.UVPoint)  # -> Point, Normal, UDirection, VDirection, Frame
target_point = Point(evalsrf.Point)
amp_2 = Amplitude(Vector=evalsrf.Normal, Amplitude=distances_2)
move_2 = Move(Geometry=target_point, Motion=amp_2)  # -> Geometry, Transform
ln_2 = Line(StartPoint=move_2.Geometry, EndPoint=target_point)
pframe = PerpFrame(Curve=ln_2, Parameter="0")
prot = RotatePlane(Plane=pframe, Angle="pi")
pln = Plane(graft(prot))
deplane = DeconstructPlane(Plane=pln)  # -> Origin, XAxis, YAxis, ZAxis
pl = PlaneNormal(Origin=deplane.Origin, ZAxis=deplane.XAxis)
angles_2 = Number(angles)
target_point_2 = Point(target_point)
rotate_2 = Rotate(Geometry=pln, Angle=expr("-x", degrees(angles_2)), Plane=pl)  # -> Geometry, Transform
ln_3 = Line(StartPoint=rotate_2.Geometry, EndPoint=graft(target_point_2))
pframe_2 = PerpFrame(Curve=ln_3, Parameter="1")
rootdir_2 = GhPythonScript()  # -> rootdir; same code as rootdir
pln_2 = Plane(flatten(rotate_2.Geometry))
prot_2 = RotatePlane(Plane=pframe_2, Angle=degrees("-90"))
filename_2 = Text(filename)
merge = Merge(Data1=Toggle(False), Data2=Toggle(False), Data3=Toggle(False))
concat_2 = Concatenate(FragmentA=rootdir_2, FragmentB=filename_2)
save_2 = Boolean(save)
gframe = GetFrame(Frame=simplify(flatten(rotate_2.Geometry)))  # -> XYZLocation, ABCOrientation
gframe_2 = GetFrame(Frame=simplify(flatten(prot_2)))  # -> XYZLocation, ABCOrientation
robot_ik = RobotInverseKinematics(Robot=kuka_kr_210, TargetTCPFrame=pln_2, AxisToggles=merge, useColorPreview=True)  # -> PoseGeometry, AxisValues, AxisFrames
mesh = Mesh(robot_ik.PoseGeometry)
savetarget = GhPythonScript(
    pos_loc=gframe.XYZLocation,
    pos_ang=gframe.ABCOrientation,
    target_loc=gframe_2.XYZLocation,
    target_ang=gframe_2.ABCOrientation,
    filepath=concat_2,
    save=save_2)  # inputs pos_loc: list of Point3d, pos_ang: list of Point3d, target_loc: list of Point3d, target_ang: list of Point3d, save: Boolean
# ---------- savetarget: Python ----------
import json
import Rhino as rh

if save:

    json_dict = {"Targets":[]}
    
    for pl,pa,tl,ta in zip(pos_loc, pos_ang, target_loc, target_ang):
        
        json_dict["Targets"].append({
            "pos_x" : pl.X,
            "pos_y" : pl.Y,
            "pos_z" : pl.Z,
            "pos_a" : pa.X,
            "pos_b" : pa.Y,
            "pos_c" : pa.Z,
            "target_x" : tl.X,
            "target_y" : tl.Y,
            "target_z" : tl.Z,
            "target_a" : ta.X,
            "target_b" : ta.Y,
            "target_c" : ta.Z,
            "target_dist" : pl.DistanceTo(tl)
            })
    
    with open(filepath, 'w') as file:
        file.write(json.dumps(json_dict, sort_keys=True, indent = 4))
# ---------- end savetarget ----------
